% Requirement links of crs_controllerdic.sldd (R2020b)

item 1 implements crs_req_func_spec.slreqx#66: Threshold of brake pressure
item 2 implements crs_req_func_spec.slreqx#65: Integral of PI
item 3 implements crs_req_func_spec.slreqx#70: Minimum Target Speed
item 4 implements crs_req_func_spec.slreqx#64: Propotional of PI
item 5 implements crs_req_func_spec.slreqx#67: Maximum Throttle Value
item 6 implements crs_req_func_spec.slreqx#69: Maximum Target Speed
item 7 implements crs_req_func_spec.slreqx#68: Minimum Throttle Value
item 8 verifies crs_req_func_spec.slreqx#8: crs_req_func_spec#8