test file "CruiseControlModeTestManager"
  coverage: Decision, SimulinkDesignVerifier

suite "Unit Test For Cruise Control Mode"

  case "Key Position" [simulation]
    model CruiseControlMode, harness CruiseControlMode_Harness
    signal scenario: Key Position (CruiseControlMode_Harness/Signal Builder)
    custom criteria:
      yout = sltest_simout.get('yout');

      % Accessing the output values of the 5th Outport
      opModeVerification = yout{5}.Values.Data;

      % Verfiying that opModeVerification contains all 1's
      test.verifyTrue(all(opModeVerification))

      % Accessing the output values of the  6th Outport
      activationStatusVerfication = yout{6}.Values.Data;

      % Verfiying that activationStatusVerfication contains all 1's
      test.verifyTrue(all(activationStatusVerfication))

  case "Drive Mode" [simulation]
    model CruiseControlMode, harness CruiseControlMode_Harness
    signal scenario: Drive Mode (CruiseControlMode_Harness/Signal Builder)
    custom criteria: same code as in custom criteria of case "Key Position"

  case "Above Break Threshold" [simulation]
    model CruiseControlMode, harness CruiseControlMode_Harness
    signal scenario: Above Break Threshold (CruiseControlMode_Harness/Signal Builder)
    custom criteria: same code as in custom criteria of case "Key Position"

  case "Vehicle Speed Above Target Range" [simulation]
    model CruiseControlMode, harness CruiseControlMode_Harness
    signal scenario: Vehicle Above Target Speed Range (CruiseControlMode_Harness/Signal Builder)
    custom criteria: same code as in custom criteria of case "Key Position"

  case "Vehicle Speed Below Target Range" [simulation]
    model CruiseControlMode, harness CruiseControlMode_Harness
    signal scenario: Vehicle Below Target Speed Range (CruiseControlMode_Harness/Signal Builder)
    custom criteria: same code as in custom criteria of case "Key Position"

suite "Unit Test For Throttle Duration"

  case "Increment" [simulation]
    model CruiseControlMode, harness CruiseControlMode_Harness
    signal scenario: Increment (CruiseControlMode_Harness/Signal Builder)
    custom criteria: same code as in custom criteria of case "Key Position"

  case "Decrement" [simulation]
    model CruiseControlMode, harness CruiseControlMode_Harness
    signal scenario: Decrement (CruiseControlMode_Harness/Signal Builder)
    custom criteria: same code as in custom criteria of case "Key Position"

  case "Increment Hold" [simulation]
    model CruiseControlMode, harness CruiseControlMode_Harness
    signal scenario: IncrementHold (CruiseControlMode_Harness/Signal Builder)
    custom criteria: same code as in custom criteria of case "Key Position"

  case "Decrement Hold" [simulation]
    model CruiseControlMode, harness CruiseControlMode_Harness
    signal scenario: DecrementHold (CruiseControlMode_Harness/Signal Builder)
    custom criteria: same code as in custom criteria of case "Key Position"