test file "TargetSpeedThrottle_Tests"

suite "Unit Tests for opMode"

  case "opMode Disabled" [simulation]
    model TargetSpeedThrottle, harness TargetSpeedThrottle_Harness
    signal scenario: opMode Disabled (TargetSpeedThrottle_Harness/Signal Builder)
    custom criteria:
      yout = sltest_simout.get('yout');

      % Accessing the output values of the 1st Outport
      reqModeVerification = yout{5}.Values.Data;

      % Verfiying that reqModeVerification contains all 1's
      test.verifyTrue(all(reqModeVerification))

  case "opMode Enabled" [simulation]
    model TargetSpeedThrottle, harness TargetSpeedThrottle_Harness
    signal scenario: opMode Enabled (TargetSpeedThrottle_Harness/Signal Builder)
    custom criteria: same code as in custom criteria of case "opMode Disabled"

  case "opMode Increment" [simulation]
    model TargetSpeedThrottle, harness TargetSpeedThrottle_Harness
    signal scenario: opMode Increment (TargetSpeedThrottle_Harness/Signal Builder)
    custom criteria: same code as in custom criteria of case "opMode Disabled"

  case "opMode Decrement" [simulation]
    model TargetSpeedThrottle, harness TargetSpeedThrottle_Harness
    signal scenario: opMode Decrement (TargetSpeedThrottle_Harness/Signal Builder)
    custom criteria: same code as in custom criteria of case "opMode Disabled"

  case "opMode Activate" [simulation]
    model TargetSpeedThrottle, harness TargetSpeedThrottle_Harness
    signal scenario: opMode Activate (TargetSpeedThrottle_Harness/Signal Builder)
    custom criteria: same code as in custom criteria of case "opMode Disabled"