% Requirement links of crs_controller.slx (R2020b)

block :1 implements crs_req_func_spec.slreqx#46: Enable Switch
block :1 implements crs_req_func_spec.slreqx#46: Enable Switch
block :11 implements crs_req_func_spec.slreqx#53: Vehicle speed
block :2 implements crs_req_func_spec.slreqx#47: Cancel Switch
block :3 implements crs_req_func_spec.slreqx#48: Set Switch
block :4 implements crs_req_func_spec.slreqx#49: Resume Switch
block :434 implements crs_req_func_spec.slreqx#58: Driver Request
block :435 implements crs_req_func_spec.slreqx#59: Status
block :436 implements crs_req_func_spec.slreqx#60: Operation Mode
block :437 implements crs_req_func_spec.slreqx#61: Target Speed
block :438 implements crs_req_func_spec.slreqx#62: Throttle value
block :440 implements crs_req_func_spec.slreqx#19: Cruise Control Mode
block :441 implements crs_req_func_spec.slreqx#37: Calculate Target Speed and Throttle Value
block :5 implements crs_req_func_spec.slreqx#50: Increment Switch
block :6 implements crs_req_func_spec.slreqx#51: Decrement Switch
block :7 implements crs_req_func_spec.slreqx#52: Brake pressure
block :8 implements crs_req_func_spec.slreqx#54: Key position
block :9 implements crs_req_func_spec.slreqx#55: Gear position